# Dynamo graph ChangeSysPath.dyn (Dynamo 2.0.3.8810)

string = StringInput("ChangeSysPath.py")  # graph input
file_from_path = FileObject(path=string)
readText = FileSystem.ReadText(file=file_from_path)
boolean = BoolSelector(false)
el_sys_id = CodeBlock { 7784174; }
cable_tray_code = StringInput("test")
python_script_from_string = PythonStringNode(script=readText, IN[0]=file_from_path, IN[1]=boolean, IN[2]=el_sys_id, IN[3]=cable_tray_code)
